test file "sltestMILSILEquivalence_tests"

suite "New Test Suite 1"

  case "sltestMILSILEquivalence_Harness1" [equivalence]
    simulation 1:
      model sltestMILSILEquivalence, harness sltestMILSILEquivalence_Harness1 (for sltestMILSILEquivalence/Controller), mode Normal
      input "Test Case:1" from sltestMILSILEquivalence_Harness1_sldvdata.mat
      input "Design Verifier (sltestMILSILEquivalence_Harness1_sldvdata.mat)" from sltestMILSILEquivalence_Harness1_sldvdata.mat
    simulation 2:
      model sltestMILSILEquivalence, harness sltestMILSILEquivalence_SILHarness1 (for sltestMILSILEquivalence/Controller), mode Normal
      input "Test Case:1" from sltestMILSILEquivalence_Harness1_sldvdata.mat
      input "Design Verifier (sltestMILSILEquivalence_Harness1_sldvdata.mat)" from sltestMILSILEquivalence_Harness1_sldvdata.mat
    iterations:
      Iteration1: ExternalInput "Test Case:1", ExternalInput "Test Case:1"